vi "index.gviweb"   [G Web Development Software 22.3.0]
panel controls:
  "Exit (development only)": bool
  "Test Start": bool
  "Test Sequence": T3[]
  "Cancel": bool
panel indicators:
  "Total Duration (s)": f64
  "Step Status": T1[]
  "Program Log": string
  "Status": string
  "Initialized": bool
  "Finalized": bool
  "Graph": f64[][]
  "Result": bool
types:
  "Color.gtype" = u32
  T1 = cluster{"Progress": f64, "Result": "Color.gtype"}
  T2 = cluster{"Waveform": enum{"Constant", "Sawtooth", "Sinusoid"}, "Amplitude": f64, "Frequency": f64}
  T3 = cluster{"Duration (s)": f64, "Waveform Data": T2, "Fault Probability": f64}
  "Waveforms.gtype" = enum{"Constant", "Sawtooth", "Sinusoid"}
  "IO Data.gtype" = cluster{"Waveform": "Waveforms.gtype", "Duration (s)": f64, "Start Time": timestamp, "Time Factor": f64, "Adjusted Amplitude": f64, "New Wave": bool, "Wave Active": bool, "Fault start time": f64}
  "Step Result.gtype" = enum{"Pass", "Fail", "Canceled"}
  "Step Status.gtype" = cluster{"Progress": f64, "Result": "Step Result.gtype", "Complete": bool}
  "Waveform Data.gtype" = cluster{"Waveform": "Waveforms.gtype", "Amplitude": f64, "Frequency": f64}
  "Test Step Data.gtype" = cluster{"Duration (s)": f64, "Waveform Data": "Waveform Data.gtype", "Fault Probability": f64}
  "Manager State.gtype" = enum{"Idle", "Initialize", "Execute", "Finalize", "Cancel", "Error"}
  "Message Queue Names.gtype" = enum{"Manager", "UI", "IO"}
  "Step Data.gtype" = cluster{"Message Queue": "Message Queue Names.gtype", "Action": string}
  "Sequence.gtype" = cluster{"Manager State": "Manager State.gtype", "Steps": "Step Data.gtype"[]}
  "Manager Data.gtype" = cluster{"Current State": "Manager State.gtype", "Current Step": "Step Data.gtype", "Remaining Steps": "Step Data.gtype"[], "Remaining Sequences": "Sequence.gtype"[], "Current Instruction": string}
  "Error Data.gtype" = cluster{"Error Origin": "Message Queue Names.gtype", "Error In": error}
uses:
  WebApp::support::Message Queue::Create All Message Queues.gvi
  WebApp::support::Message Queue::Dequeue Message.gvi
  WebApp::support::globals.gviweb
  WebApp::program instructions::Report Step Complete.gviweb
  WebApp::IO::Handle Next Waveform.gviweb
  WebApp::IO::Generate Waveform.gviweb
  WebApp::IO::Handle Hardware IO.gviweb
  WebApp::development::Check Test Sequence Complete.gviweb
  WebApp::support::Generate Undefined Message Error.gviweb
  WebApp::support::Handle Error.gviweb
  WebApp::UI::Define Preset Test Sequence.gviweb
  WebApp::UI::Prep Step Staus for Display.gviweb
  WebApp::UI::Calculate Test Duration.gviweb
  WebApp::UI::Validate Test Sequence.gviweb
  WebApp::UI::IO Data::Handle Data Remaining in Queue.gviweb
  WebApp::UI::Get Result Color.gviweb
  WebApp::UI::IO Data::Receive IO Data.gviweb
  WebApp::program instructions::Define Program Instructions.gviweb
  WebApp::support::Message Queue::Enqueue Message (Single).gvi
  WebApp::UI::Messages::Append Log Text.gviweb
  WebApp::program instructions::Handle Next Sequence.gviweb
  WebApp::program instructions::Handle Next Step.gviweb
  NI::G Core::Error::Build Error Cluster.gvi
  WebApp::UI::Messages::Send Sequence Complete UI Updates.gviweb
  WebApp::UI::Messages::Update Program Status.gviweb
  WebApp::support::Error Handler - Event Handling Loop.gvi
diagram:
  w1 = bool FALSE  # Stop Event
  Create User Event[EventName="Stop Event"](user event data type=w1) -> (error out=w2, user event out=w3)
  w4 = ["Manager", "UI", "IO"]  # Queue List
  # #feature_queue
  # Hardware fault
  # 	be able to clear error with corresponding case in IO
  # 	handle during initialize or execute
  # Abort
  # Pause
  # Pass initial instruction data to individual steps
  # Display test history/ data
  # Select between historical test data for display
  # 	Historical analysis/ comparison
  # Splining/ smooth transitions between waveforms
  # 	Force sawtooth to return to 0 before waveform transition?
  # Unit tests
  # Check for empty test sequence
  Array Size(array=w4) -> (size(s)=w5)
  call "Create All Message Queues.gvi"(Loop Count=w5, error in=w2) -> (Message Queues=w6, error out=w7)
  Obtain Queue(element data type=f64[] [], name="IO data") -> (error out=w8, queue out=w9)
  Array Index(array=w6) -> (out0["Manager"]=w10, out1["IO"]=w11)
  s1 = uninitialised  # shift register
  s2 = uninitialised  # shift register
  while {
    call "Dequeue Message.gvi"(message queue in=w11, timeout in milliseconds=0, error in=w7) -> (timed out?=w12, message queue out=w13, message=w14, message data=w15, error out=w16)
    # UI Update Loop
    case (w14) ignore case {  # Message Cases
      frame "SW Init" {
        w17 = w16
        w18 = default
        w19 = s1
        w20 = "IO Data.gtype" {all zero or empty}
      }
      frame "Initialize" {
        disable {
          frame Disabled {
            # #Integrate_Hardware
            # Hardware uninitialization goes here
            w21 = w16
          }
          frame Enabled {
            call "globals.gviweb"() -> (Globals=w22)
            Property Node(instance in=w22) -> ("Hardware Initialize Duration (s)"=w23)
            # #debug
            Multiply(w23, 1000) -> w24
            Wait(time to wait=w24)
            w21 = w16
          }
        }
        call "Report Step Complete.gviweb"(Manager Queue=w10, This Queue Name="IO", Step Name=w14, Input_3=w21) -> (Output_2=w17)
        w18 = default
        w19 = s1
        w20 = s2
      }
      frame "Finalize" {
        disable {
          frame Disabled {
            # #Integrate_Hardware
            # Hardware uninitialization goes here
            w25 = w16
          }
          frame Enabled {
            call "globals.gviweb"() -> (Globals=w26)
            Property Node(instance in=w26) -> ("Hardware Finalize Duration (s)"=w27)
            # #debug
            Multiply(w27, 1000) -> w28
            Wait(time to wait=w28)
            w25 = w16
          }
        }
        call "Report Step Complete.gviweb"(Manager Queue=w10, This Queue Name="IO", Step Name=w14, Input_3=w25) -> (Output_2=w17)
        w18 = default
        w19 = s1
        w20 = s2
      }
      frame "Execute" {
        # #todo move some of this functionality to initialization and check if test sequence is empty
        # report empty back to manager
        call "Handle Next Waveform.gviweb"(Test Sequence in=$"Test Sequence", IO Data In=s2) -> (Test Sequence out=w19, IO Data out=w20)
        w17 = w16
        w18 = default
      }
      frame "Cancel" {
        sequence {
          frame 0 {
            # Stop IO
            Property Node(instance in=s2, "Wave Active"=FALSE) -> (instance out=w20)
          }
        }
        call "Report Step Complete.gviweb"(Manager Queue=w10, This Queue Name="IO", Step Name=w14, Input_3=w16) -> (Output_2=w17)
        w18 = default
        w19 = s1
      }
      frame "Exit" {
        Release Queue(queue=w13) -> (error out=w29)
        Merge Errors(w16, w29) -> (error out=w17)
        w18 = TRUE
        w19 = s1
        w20 = s2
      }
      frame Default {
        case (w12) {
          frame True {
            Property Node(instance in=s2) -> ("Wave Active"=w30, instance out=w31)
            # No message -> handle output
            case (w30) {
              frame False, Default {
                w20 = w31
                w17 = w16
                w19 = s1
              }
              frame True {
                Property Node(instance in=w31) -> ("New Wave"=w32, instance out=w33)
                case (w32) {
                  frame False, Default {
                    w34 = w33
                  }
                  frame True {
                    Get Current Time() -> (current time=w35)
                    # only save init timestamp at wave start
                    Property Node(instance in=w33, "Start Time"=w35, "New Wave"=FALSE) -> (instance out=w34)
                  }
                }
                call "Generate Waveform.gviweb"(IO Data=w34) -> (Time Elapsed=w36, IO data out=w37, Wave Value=w38, Fraction Complete=w39)
                call "Handle Hardware IO.gviweb"(IO data in=w37, Hardware output=w38, Time Elapsed=w36) -> (IO data out=w40, Hardware input=w41)
                call "Check Test Sequence Complete.gviweb"(This Queue Name="IO", Test Sequence in=s1, IO data in=w40, Fraction Complete=w39, Manager Queue=w10) -> (Test Sequence out=w19, IO data out=w20, Fraction Complete (includes messages)=w42)
                Build Array(w42, w38, w41) -> w43
                Enqueue Element(element=w43, error in=w16, queue=w9) -> (error out=w17)
              }
            }
          }
          frame False {
            # Received message
            call "Generate Undefined Message Error.gviweb"(Queue Name="IO", Message=w14, Error in=w16) -> (Error out=w17)
            w20 = s2
            w19 = s1
          }
        }
        w18 = default
      }
    }
    call "Handle Error.gviweb"(Input=w10, Input_2="IO", Output_2=w17) -> (Output_3=w44)
    Wait(time to wait=50)
    next s1 = w19
    next s2 = w20
    stop if w18
  }
  Array Index(array=w6) -> (out0["Manager"]=w45, out1["UI"]=w46)
  Merge Errors(w7, w8) -> (error out=w47)
  s3 = uninitialised  # shift register
  s4 = uninitialised  # shift register
  s5 = uninitialised  # shift register
  s6 = uninitialised  # shift register
  s7 = uninitialised  # shift register
  s8 = uninitialised  # shift register
  while {
    call "Dequeue Message.gvi"(message queue in=w46, timeout in milliseconds=s4, error in=w47) -> (timed out?=w48, message queue out=w49, message=w50, message data=w51, error out=w52)
    # UI Update Loop
    # s8: Step Index
    # s7: Test Steps
    # s4: Dequeue Timeout
    case (w50) ignore case {  # Message Cases
      frame "SW Init" {
        Property Node(instance in=reference to "Result", "Value"=FALSE, "Text"=[" ", " "])
        Property Node(instance in=reference to "Initialized", "Value"=FALSE)
        Property Node(instance in=reference to "Finalized", "Value"=FALSE)
        Property Node(instance in=reference to "Finalized", "Value"=FALSE)
        Property Node(instance in=reference to "Test Sequence", "Disabled"=FALSE)
        Property Node(instance in=reference to "Initialized", "Value"=FALSE, error in=w52) -> (error out=w61, instance out=w62)
        Property Node(instance in=reference to "Status", "Value"="Idle", error in=w52) -> (error out=w63, instance out=w64)
        Property Node(instance in=reference to "Program Log", "Value"="", error in=w52) -> (error out=w65, instance out=w66)
        Build Array(w62, w64, w66) -> w67
        Merge Errors(w61, w63, w65) -> (error out=w68)
        s9 = w68  # shift register
        for {
          w69 = each element of w67
          Close Reference(error in=s9, reference=w69) -> (error out=w70)
          next s9 = w70
        }
        call "Define Preset Test Sequence.gviweb"() -> (Preset Test Sequence=w71)
        Array Size(array=w71) -> (size(s)=w59)
        Initialize Array(element="Step Status.gtype" {all zero or empty}, size=w59) -> w58
        call "Prep Step Staus for Display.gviweb"(Steps status out=w58) -> (Step Status=w72)
        Property Node(instance in=reference to "Step Status", "Value"=w72)
        Property Node(instance in=reference to "Test Sequence", "Value"=w71)
        call "Calculate Test Duration.gviweb"(Test Sequences=w71) -> (Total Duration (s)=w73)
        Property Node(instance in=reference to "Total Duration (s)", "Value"=w73)
        w53 = s9
        w54 = default
        w55 = ""
        w56 = -1
        w57 = f64[][] []
        w60 = 0
      }
      frame "Handle Test Change" {
        Variant To Data(error in (no error)=w52, type="Test Step Data.gtype"[] [], variant=w51) -> (data=w74, error out=w75)
        Array Size(array=w74) -> (size(s)=w59)
        call "Calculate Test Duration.gviweb"(Test Sequences=w74) -> (Total Duration (s)=w76)
        $"Total Duration (s)" <- w76
        call "Validate Test Sequence.gviweb"(Input=reference to "Test Sequence", UI Queue=w49, data=w74, error in=w75) -> (Error out=w53)
        w54 = default
        w55 = s3
        w56 = s4
        w57 = s5
        w58 = s6
        w60 = s8
      }
      frame "Execute" {
        # start polling to process data from IO loop
        call "Report Step Complete.gviweb"(Manager Queue=w45, This Queue Name="UI", Step Name=w50, Input_3=w52) -> (Output_2=w53)
        w54 = default
        w55 = s3
        w56 = 0
        w57 = s5
        w58 = s6
        w59 = s7
        w60 = s8
      }
      frame "Update Status" {
        Variant To Data(error in (no error)=w52, type=string "", variant=w51) -> (data=w77, error out=w53)
        Format Into String(formatString="%s\n%s", s3, w77) -> w55
        $"Program Log" <- w55
        w54 = default
        w56 = s4
        w57 = s5
        w58 = s6
        w59 = s7
        w60 = s8
      }
      frame "Update Program Status" {
        Variant To Data(error in (no error)=w52, type=w50, variant=w51) -> (data=w78, error out=w53)
        $Status <- w78
        w54 = default
        w55 = s3
        w56 = s4
        w57 = s5
        w58 = s6
        w59 = s7
        w60 = s8
      }
      frame "Initialize Complete" {
        $Initialized <- TRUE
        w53 = w52
        w54 = default
        w55 = s3
        w56 = s4
        w57 = s5
        w58 = s6
        w59 = s7
        w60 = s8
      }
      frame "Initialize" {
        Property Node(instance in=reference to "Result", "Value"=FALSE)
        Property Node(instance in=reference to "Test Sequence", "Disabled"=TRUE)
        Property Node(instance in=reference to "Initialized", "Value"=FALSE)
        Property Node(instance in=reference to "Finalized", "Value"=FALSE)
        # Enure at least 1 step is present
        Max And Min(x=s7, y=1) -> (max(x,y)=w79: i32)
        Initialize Array(element="Step Status.gtype" {all zero or empty}, size=w79) -> w58
        call "Prep Step Staus for Display.gviweb"(Steps status out=w58) -> (Step Status=w80)
        Property Node(instance in=reference to "Step Status", "Value"=w80, error in=w52) -> (error out=w81)
        call "Report Step Complete.gviweb"(Manager Queue=w45, This Queue Name="UI", Step Name=w50, Input_3=w81) -> (Output_2=w53)
        w54 = default
        w55 = s3
        w56 = s4
        w57 = f64[][] []
        w59 = s7
        w60 = 0
      }
      frame "Execute Complete" {
        # Handle any data remaining in queue
        call "Handle Data Remaining in Queue.gviweb"(Input_3=reference to "Graph", Input_2=reference to "Step Status", Input_4=w9, Input_5=s8, Input=s5, Input_6=s6, Input_7=w52) -> (Output=w60, Output_3=w57, Output_4=w58, Output_2=w53)
        w54 = default
        w55 = s3
        w56 = s4
        w59 = s7
      }
      frame "Finalize" {
        s10 = "Pass"  # shift register
        for {
          w82 = each element of s6
          Property Node(instance in=w82) -> ("Result"=w83)
          case (s10) {
            frame "Pass", Default {
              w84 = w83
            }
            frame "Fail" {
              case (w83) {
                frame Default {
                  w84 = w83
                }
                frame "Pass" {
                  w84 = s10
                }
              }
            }
            frame "Canceled" {
              w85 = "Canceled"  # Step Result
              w84 = w85
            }
          }
          next s10 = w84
        }
        call "Get Result Color.gviweb"(Input=s10) -> (Output=w86)
        Format Into String(formatString="%s", s10) -> w87
        Build Array(w87) -> w88
        # stop polling
        Property Node(instance in=reference to "Result", "TrueColor"=w86, "Text"=w88)
        $Result <- TRUE
        Property Node(instance in=reference to "Test Sequence", "Disabled"=TRUE)
        call "Report Step Complete.gviweb"(Manager Queue=w45, This Queue Name="UI", Step Name=w50, Input_3=w52) -> (Output_2=w53)
        w54 = default
        w55 = s3
        w56 = -1
        w57 = s5
        w58 = s6
        w59 = s7
        w60 = s8
      }
      frame "Finalize Complete" {
        $Finalized <- TRUE
        Property Node(instance in=reference to "Test Sequence", "Disabled"=FALSE)
        w53 = w52
        w54 = default
        w55 = s3
        w56 = s4
        w57 = s5
        w58 = s6
        w59 = s7
        w60 = s8
      }
      frame "Cancel" {
        Array Index(array=s6) -> (out0[s8]=w89)
        Property Node(instance in=w89, "Result"="Canceled") -> (instance out=w90)
        Replace Array Subset(inArray=s6, index=s8, new=w90) -> w91
        call "Handle Data Remaining in Queue.gviweb"(Input_3=reference to "Graph", Input_2=reference to "Step Status", Input_4=w9, Input_5=s8, Input=s5, Input_6=w91, Input_7=w52) -> (Output=w60, Output_3=w57, Output_4=w58, Output_2=w92)
        call "Report Step Complete.gviweb"(Manager Queue=w45, This Queue Name="UI", Step Name=w50, Input_3=w92) -> (Output_2=w53)
        w54 = default
        w55 = s3
        w56 = s4
        w59 = s7
      }
      frame "Cancel Complete" {
        w53 = w52
        w54 = default
        w55 = s3
        w56 = s4
        w57 = s5
        w58 = s6
        w59 = s7
        w60 = s8
      }
      frame "Exit" {
        Release Queue(queue=w49) -> (error out=w93)
        Release Queue(queue=w9) -> (error out=w94)
        Merge Errors(w52, w93, w94) -> (error out=w53)
        w54 = TRUE
        w55 = s3
        w56 = s4
        w57 = s5
        w58 = s6
        w59 = s7
        w60 = s8
      }
      frame Default {
        case (w48) {
          frame True {
            Wait(time to wait=500)
            call "Receive IO Data.gviweb"(Test data in=s5, Steps status in=s6, Step Index in=s8, error in=w52, IO Data Queue=w9) -> (Test data out=w57, Steps status out=w58, Step Index out=w60, error out=w53, Test Data for Graph=w95)
            $Graph <- w95
            call "Prep Step Staus for Display.gviweb"(Steps status out=w58) -> (Step Status=w96)
            $"Step Status" <- w96
          }
          frame False {
            call "Generate Undefined Message Error.gviweb"(Queue Name="UI", Message=w50, Error in=w52) -> (Error out=w53)
            w57 = s5
            w58 = s6
            w60 = s8
          }
        }
        w54 = default
        w55 = s3
        w56 = s4
        w59 = s7
      }
    }
    call "Handle Error.gviweb"(Input=w45, Input_2="UI", Output_2=w53) -> (Output_3=w97)
    next s3 = w55
    next s4 = w56
    next s5 = w57
    next s6 = w58
    next s7 = w59
    next s8 = w60
    stop if w54
  }
  Array Index(array=w6) -> (out0["Manager"]=w98)
  call "Define Program Instructions.gviweb"() -> (Instructions=w99, Instruction names=w100)
  s11 = uninitialised  # shift register
  while {
    # w6: Message Queues
    call "Dequeue Message.gvi"(message queue in=w98, error in=w7) -> (message queue out=w101, message=w102, message data=w103, error out=w104)
    # "Manager": Manager Queue Name
    # w3: Stop Event
    # s11: Manager Data
    # w99: Instructions
    # w100: Instruction Names
    case (w102) ignore case {  # Message Cases
      frame "SW Init" {
        w105 = w104
        w106 = default
        w107 = "Manager Data.gtype" {all zero or empty}
      }
      frame "Test Sequence Change" {
        Array Index(array=w6) -> (out0["UI"]=w108)
        call "Enqueue Message (Single).gvi"(message queue in=w108, message="Handle Test Change", message data=w103, error in=w104) -> (error out=w105)
        w106 = default
        w107 = s11
      }
      frame "Error" {
        Variant To Data(error in (no error)=w104, type="Error Data.gtype" {all zero or empty}, variant=w103) -> (data=w109, error out=w110)
        Property Node(instance in=w109) -> ("Error Origin"=w111, "Error In"=w112)
        Property Node(instance in=w112) -> ("code"=w113, "source"=w114)
        w115 = "================\nError\n\nAt: %s\n\nCode: %d\n%s\n================"
        Format Into String(formatString=w115, errIn=w110, w111, w113, w114) -> (outString=w116, errOut=w117)
        call "Append Log Text.gviweb"(Message Queues in=w6, Update Tex=w116, Error in=w117) -> (Error out_2=w105)
        w106 = default
        w107 = s11
      }
      frame "Exit Pressed" {
        # #development
        s12 = w104  # shift register
        for {
          w118 = each element of w6
          call "Enqueue Message (Single).gvi"(message queue in=w118, message="Exit", error in=s12) -> (error out=w119)
          next s12 = w119
        }
        w105 = s12
        w106 = default
        w107 = s11
      }
      frame "Exit" {
        Generate User Event(event data=TRUE, user event=w3) -> (error out=w120)
        Release Queue(queue=w101) -> (error out=w121)
        Merge Errors(w121, w120) -> (error out=w105)
        w106 = TRUE
        w107 = s11
      }
      frame Default {
        call "Generate Undefined Message Error.gviweb"(Queue Name="Manager", Message=w102, Error in=w104) -> (Error out=w105)
        w106 = default
        w107 = s11
      }
      frame "Instruction" {
        # w122: Instruction Name
        Variant To Data(error in (no error)=w104, type=w102, variant=w103) -> (data=w122, error out=w123)
        Search 1D Array(1D array=w100, element=w122) -> (index of element=w124)
        case (w124) {
          frame Default {
            Array Index(array=w99) -> (out0[w124]=w125)
            Property Node(instance in=w125) -> ("Init Info:Valid Starts"=w126, instance out=w127)
            Property Node(instance in=s11) -> ("Current State"=w128, instance out=w129)
            Search 1D Array(1D array=w126, element=w128) -> (index of element=w130)
            # Message in sequence start list -> ensure in valid start state
            case (w130) {
              frame Default {
                # In valid state for recieved message -> react
                Property Node(instance in=w127) -> ("Sequences"=w131)
                Format Into String(formatString="******************\nStart: %s\n******************", errIn=w123, w122) -> (outString=w132, errOut=w133)
                call "Append Log Text.gviweb"(Message Queues in=w6, Update Tex=w132, Error in=w133) -> (Message Queues out=w134, Error out_2=w135)
                call "Handle Next Sequence.gviweb"(Manager data in=w129, Sequences=w131, error in=w135, Message Queues=w134) -> (manager data out=w136, Sequence Steps=w137, End Instruction=w138, error out=w139, Message Queues out=w140)
                case (w138) {
                  frame True {
                    # #verify - new instruction, but sequences empty
                    w141 = "-------------------------------------\nInstruction Sequences Empty\n-------------------------------------"
                    call "Append Log Text.gviweb"(Message Queues in=w140, Update Tex=w141, Error in=w139) -> (Error out_2=w105)
                    w107 = w136
                  }
                  frame False {
                    Property Node(instance in=w136, "Current Instruction"=w122) -> (instance out=w142)
                    # Start first step in first sequence
                    call "Handle Next Step.gviweb"(Manager Data in=w142, Sequence Steps=w137, Error in=w139, Nessage Queues in=w140) -> (Manager Data out=w107, Error out=w105)
                  }
                }
              }
              frame -1 {
                w143 = """-------------------------------------
Received inavalid message for current status

Invalid Message: %s

State: %s
Currently waiting on: %s
-------------------------------------"""
                Property Node(instance in=w129) -> ("Current State"=w144, "Current Step:Message Queue"=w145)
                Format Into String(formatString=w143, errIn=w123, w122, w144, w145) -> (outString=w146, errOut=w147)
                call "Append Log Text.gviweb"(Message Queues in=w6, Update Tex=w146, Error in=w147) -> (Error out_2=w105)
                w107 = w129
              }
            }
          }
          frame -1 {
            # Instruction name missing from list -> undefined
            Format Into String(formatString="Instruction \"%s\" undefined.", w122) -> w148
            call "Build Error Cluster.gvi"(code=1, description=w148, error in=w123) -> (error out=w105)
            w107 = s11
          }
        }
        w106 = default
      }
      frame "Step Complete" {
        Property Node(instance in=s11) -> ("Current Step"=w149)
        Variant To Data(error in (no error)=w104, type=w149, variant=w103) -> (data=w150, error out=w151)
        Is Equal[ComparisonMode=CompareAggregates](x=w149, y=w150) -> w152
        case (w152) {
          frame False, Default {
            w153 = "Unexpected \"Step Complete\" message \n\nFrom: %s with action %s\nExpected: %s with action %s"
            Property Node(instance in=w150) -> ("Message Queue"=w154, "Action"=w155)
            Property Node(instance in=w149) -> ("Message Queue"=w156, "Action"=w157)
            Format Into String(formatString=w153, w154, w155, w156, w157) -> w158
            call "Append Log Text.gviweb"(Message Queues in=w6, Update Tex=w158, Error in=w151) -> (Error out_2=w105)
            w107 = s11
          }
          frame True {
            # Expected complete message received
            Property Node(instance in=s11) -> ("Remaining Steps"=w159, instance out=w160)
            Array Size(array=w159) -> (size(s)=w161)
            Property Node(instance in=w149) -> ("Message Queue"=w162, "Action"=w163)
            Format Into String(formatString="Completed %s %s", errIn=w151, w162, w163) -> (outString=w164, errOut=w165)
            call "Append Log Text.gviweb"(Message Queues in=w6, Update Tex=w164, Error in=w165) -> (Message Queues out=w166, Error out_2=w167)
            case (w161) {
              frame Default {
                # Steps remaining -> handle next step
                call "Handle Next Step.gviweb"(Manager Data in=w160, Sequence Steps=w159, Error in=w167, Nessage Queues in=w166) -> (Manager Data out=w107, Error out=w105)
              }
              frame 0 {
                Property Node(instance in=w160) -> ("Remaining Sequences"=w168, "Current State"=w169, instance out=w170)
                call "Send Sequence Complete UI Updates.gviweb"(Message queues in=w166, Current State=w169, Error In=w167) -> (Message queues out=w171, Error out=w172)
                call "Handle Next Sequence.gviweb"(Manager data in=w170, Sequences=w168, error in=w172, Message Queues=w171) -> (manager data out=w173, Sequence Steps=w174, End Instruction=w175, error out=w176, Message Queues out=w177)
                Property Node(instance in=w173) -> ("Current State"=w178, instance out=w179)
                # Sequence complete -> handle next sequence if it exists
                Format Into String(formatString="%s", errIn=w176, w178) -> (outString=w180, errOut=w181)
                call "Update Program Status.gviweb"(Message Queues in=w177, Status=w180, Error in=w181) -> (Message Queues out=w182, Error out=w183)
                case (w175) {
                  frame False, Default {
                    # Handle next step of next sequence
                    call "Handle Next Step.gviweb"(Manager Data in=w179, Sequence Steps=w174, Error in=w183, Nessage Queues in=w182) -> (Manager Data out=w107, Error out=w105)
                  }
                  frame True {
                    # No more sequences -> Instruction complete
                    Property Node(instance in=w179) -> ("Current Instruction"=w184, instance out=w107)
                    Format Into String(formatString="******************\nComplete: %s\n******************", errIn=w183, w184) -> (outString=w185, errOut=w186)
                    call "Append Log Text.gviweb"(Message Queues in=w182, Update Tex=w185, Error in=w186) -> (Error out_2=w105)
                  }
                }
              }
            }
          }
        }
        w106 = default
      }
    }
    call "Handle Error.gviweb"(Input=w101, Input_2="Manager", Output_2=w105) -> (Output_3=w187)
    next s11 = w107
    stop if w106
  }
  Register For Events("Stop Event"=w3) -> (event registration refnum out=w188)
  # #todo
  # describe step complete case in documentation
  # hide exit button conditionally with flag - if possible
  # make UI more presentable
  #
  # change status text so instruction, sequence and steps are clearly identifiable
  # 	sequence not to be confused with test sequence (maybe change one to routine?)
  # create/ configure simulation cases/ flags
  # clean up
  # 	UI loop
  # 	IO loop
  # 	save all text log messages in same place
  Array Index(array=w6) -> (out0["Manager"]=w189)
  # Run Test Sequence example
  #
  # State: Idle
  #
  # Start Pressed
  #
  # Initialize
  # 	>> To UI ---Initialize
  # 	Waiting on UI
  # 	>> To IO ---Initialize
  # 	Waiting on IO
  # Execute
  # 	>> To UI ---Execute
  # 	Waiting on UI
  # 	>> To IO ---Execute
  # 	Waiting on IO
  # Finalize
  # 	>> To IO ---Finalize
  # 	Waiting on IO
  # 	>> To UI ---Finalize
  # 	Waiting on UI
  # Idle
  # This framework behind this sequencer operates by handling instructions (command lists) in the instruction case of the manager loop. The instruction will only begin if the manager is in a valid state to accept it. Instructions are initiated by sending an "Instruction" message via the manager's queue. The sequences in that instruction and their nested steps are then executed sequentially with the manager expecting a response to indicate each step's completion via the Report Step Complete VI. The manager will then continue on the to next step and next sequence as they're store in the sequences array. In each sequence element, a manager state name is defined. There's also a nested array containing the individual steps to be executed, each containing a message queue/ loop name and a message defining the action to be completed. The names of the step messages do not have to match the name of the manager state for that sequence.
  #
  # Instructions cannot be queued. There can only be one active at a time.
  #
  # Instruction names, start states and corresponding sequences are defined and stored in the Define Program Instructions VI, being made available to the manager at program start.
  s13 = w188  # shift register
  while {
    event (dynamic events = s13) {
      on "Test Start" Value changed {
        call "Enqueue Message (Single).gvi"(message queue in=w189, message="Instruction", message data="Run Test Sequence") -> (message queue out=w192, error out=w191)
        w190 = default
      }
      on "Cancel" Value changed {
        call "Enqueue Message (Single).gvi"(message queue in=w189, message="Instruction", message data="Cancel") -> (message queue out=w192, error out=w191)
        w190 = default
      }
      on "Exit (development only)" Value changed {
        call "Enqueue Message (Single).gvi"(priority message=TRUE, message queue in=w189, message="Exit Pressed") -> (message queue out=w192, error out=w191)
        w190 = default
      }
      on dynamic event 0 {
        # The Message Handling Loop processed an "Exit" message, which fired this event to stop the Event Handling Loop.
        w190 = TRUE
        w191 = default
        w192 = w189
      }
      on "Test Sequence" Value changed {
        Event Data() -> ("New Value"=w193)
        To Variant(anything=w193) -> w194
        call "Enqueue Message (Single).gvi"(message queue in=w189, message="Test Sequence Change", message data=w194) -> (message queue out=w192, error out=w191)
        w190 = default
      }
    }
    call "Error Handler - Event Handling Loop.gvi"(message queue in=w192, error in=w191) -> (dup error in=w195)
    stop if w190
  }
  Unregister For Events(error in=w195, event registration refnum=s13) -> (error out=w196)
  Merge Errors(w196, w187, w97, w44) -> (error out=w197)
  Destroy User Event(error in=w197, user event=w3)
